# Dynamo graph Excel-Sheet Info - A.dyn (Dynamo 2.6.1.8786)

# group: GET DATA FROM EXCEL
file_path = Filename(".\TG KAWA_DETAIL DESIGN DRAWING LIST.xlsx")
file_from_path = FileObject(path=file_path)
insert_sheet_name_case_sensitive = StringInput("TG SHEET")
importExcel = Data.ImportExcel(file=file_from_path, sheetName=insert_sheet_name_case_sensitive)
excel_start = DoubleInput(1)  # graph input
excel_end = DoubleInput(57)  # graph input
code_block = CodeBlock(x=excel_start, y=excel_end) { a=x-1; b=y-1; [a..b]; }
getItemAtIndex = List.GetItemAtIndex(list=importExcel, index=code_block.out2)

# group: EXCEL DATA SORT AND FILTER BY SERIES
flatten = List.Flatten(list=getItemAtIndex@L2)
code_block_2 = CodeBlock { null; "fred"; }
eq = _ == code_block_2.out0  # unwired: x
replaceByCondition = Replace(item=flatten, replaceWith=code_block_2.out1, condition=eq)
code_block_3 = CodeBlock { 1; }
count = List.Count(list=replaceByCondition)
code_block_4 = CodeBlock(a=code_block_3, b=count) { x=a-1; y=b-1; [x..y]; "fred"; }
getItemAtIndex_2 = List.GetItemAtIndex(list=replaceByCondition, index=code_block_4.out2)
countOccurrences = String.CountOccurrences(str=getItemAtIndex_2, searchFor=code_block_4.out3)
code_block_5 = CodeBlock { 1; }
eq_2 = countOccurrences == code_block_5
filterByBoolMask = List.FilterByBoolMask(list=countOccurrences, mask=eq_2)
sum = Math.Sum(values=filterByBoolMask.in)
sum_of_nulls = CodeBlock { 2; }
ge = sum >= sum_of_nulls
filterByBoolMask_2 = List.FilterByBoolMask(list=getItemAtIndex_2, mask=ge)

# group: EXCEL DATA SORT BY CONTENT (SHEET NAME, NUMBER AND PAPER SIZE)
watch = Watch(filterByBoolMask_2.out)
flatten_2 = List.Flatten(list=watch@L2)
code_block_6 = CodeBlock { 3; 0; }
chop = List.Chop(lengths=code_block_6.out0)  # unwired: list
map = List.Map(list=flatten_2, f_x=chop)
getItemAtIndex_3 = List.GetItemAtIndex(list=map@L3, index=code_block_6.out1)
transpose = List.Transpose(lists=getItemAtIndex_3)
sheet_details = CodeBlock(SHEETNUMBER=transpose, SHEETNAME=transpose, PAPERSIZE=transpose) { SHEETNUMBER[0]; SHEETNAME[1]; PAPERSIZE[2]; }
watch_2 = Watch(sheet_details.out0)

# group: SHEET NUMBER CHECK FOR DUPLICATION
uniqueItems = List.UniqueItems(list=watch_2)
groupByKey = List.GroupByKey(list=watch_2, keys=watch_2)
watch_3 = Watch(groupByKey.unique_keys)
watch_4 = Watch(groupByKey.groups)

# group: SHEET CREATION FROM EXCEL FILE
TITLEBLOCK = FamilyTypes("SKL_A1_METRIC_2021_R1:SKL_A1_METRIC_2021_R1")  # graph input
views = Views("01 - FIRST FLR")

byNameNumberTitleBlockAndView = Sheet.ByNameNumberTitleBlockAndView(sheetName=sheet_details.out1, sheetNumber=sheet_details.out0, titleBlockFamilyType=TITLEBLOCK, view=views)

# group: EXCEL DATA SORT BY SERIES AND NAME
watch_5 = Watch(filterByBoolMask_2.in)
flatten_3 = List.Flatten(list=watch_5@L2)
code_block_7 = CodeBlock { 2; "fred"; }
chop_2 = List.Chop(lengths=code_block_7.out0)  # unwired: list
map_2 = List.Map(list=flatten_3, f_x=chop_2)
eq_3 = map_2 == code_block_7.out1
filterByBoolMask_3 = List.FilterByBoolMask(list=map_2, mask=eq_3)
watch_6 = Watch(filterByBoolMask_3.out)
flatten_4 = List.Flatten(list=watch_6)
clean = List.Clean(list=flatten_4)
chop_3 = List.Chop(list=clean, lengths=code_block_7.out0)

watch_7 = Watch(chop_3)
