# Dynamo graph Excel-Sheet Info - B.dyn (Dynamo 2.6.1.8786)

# group: GET SHEET DETAILS
categories = Categories("OST_Sheets")
all_elements_of_category = ElementsOfCategory(Category=categories)
code_block = CodeBlock { "Sheet Number"; "-"; }
getParameterValueByName = Element.GetParameterValueByName(element=all_elements_of_category, parameterName=code_block.out0)

# group: ADDITIONAL FILTER TO SEPARATE EXISTING LAYOUTS FROM NEW LAYOUTS
code_block_2 = CodeBlock { "2577"; }
contains = String.Contains(str=getParameterValueByName, searchFor=code_block_2)
filterByBoolMask = List.FilterByBoolMask(list=all_elements_of_category, mask=contains)
getParameterValueByName_2 = Element.GetParameterValueByName(element=filterByBoolMask.in, parameterName=code_block.out0)

# group: MANIPULATE SHEET DETAILS
split = String.Split(str=getParameterValueByName_2, separator0=code_block.out1)
this_should_be_a_list_e_g_0_1 = CodeBlock { 0..1; }
removeItemAtIndex = List.RemoveItemAtIndex(indices=this_should_be_a_list_e_g_0_1)  # unwired: list
map = List.Map(list=split, f_x=removeItemAtIndex)
flatten = List.Flatten(list=map@L2)
transpose = List.Transpose(lists=flatten)

# group: SET SHEET DETAILS AS PER UNICLASS
setParameterByName = Element.SetParameterByName(element=filterByBoolMask.in)  # unwired: parameterName, value
sheet_numbering_convention = CodeBlock { ["Level Code","Format Code","Discipline Code","Sheet Number"]; }
combine = List.Combine(comb=setParameterByName, list1=sheet_numbering_convention, list2=transpose)
