# Dynamo graph Excel-Sheet Info - C.dyn (Dynamo 2.6.1.8786)

# group: GET SHEET DETAILS
categories = Categories("OST_Sheets")
all_elements_of_category = ElementsOfCategory(Category=categories)
code_block = CodeBlock { "Sheet Number"; }
getParameterValueByName = Element.GetParameterValueByName(element=all_elements_of_category, parameterName=code_block)

# group: SORT SHEETS IN DRAWING BY THE SHEET NUMBER
getParameterValueByName_2 = Element.GetParameterValueByName(parameterName=code_block)  # unwired: element
sortByFunction = List.SortByFunction(list=all_elements_of_category, func=getParameterValueByName_2)
sort = List.Sort(list=getParameterValueByName)

# group: FILTER BASED ON NUMBERING SERIES?
toNumber = String.ToNumber(str=sort)
code_block_2 = CodeBlock { 1; }

clean = List.Clean(list=toNumber)

# group (continued): FILTER BASED ON NUMBERING SERIES?
ge = clean >= code_block_2  # lacing=Longest
filterByBoolMask = List.FilterByBoolMask(list=sortByFunction, mask=ge)
filterByBoolMask_2 = List.FilterByBoolMask(list=sort, mask=ge)

# group: GET DATA FROM EXCEL
file_path = Filename("C:\Users\user\Desktop\TG KAWA\TG KAWA_DETAIL DESIGN DRAWING LIST.xlsx")
file_from_path = FileObject(path=file_path)
insert_sheet_name_case_sensitive = StringInput("TG SHEET")  # graph input
importExcel = Data.ImportExcel(file=file_from_path, sheetName=insert_sheet_name_case_sensitive)
excel_start = DoubleInput(1)  # graph input
excel_end = DoubleInput(57)  # graph input
code_block_3 = CodeBlock(x=excel_start, y=excel_end) { a=x-1; b=y-1; [a..b]; }
getItemAtIndex = List.GetItemAtIndex(list=importExcel, index=code_block_3.out2)

# group: EXCEL DATA SORT AND FILTER BY SERIES
flatten = List.Flatten(list=getItemAtIndex@L2)
code_block_4 = CodeBlock { null; "fred"; }
eq = _ == code_block_4.out0  # unwired: x
replaceByCondition = Replace(item=flatten, replaceWith=code_block_4.out1, condition=eq)
code_block_5 = CodeBlock { 1; }
count = List.Count(list=replaceByCondition)
code_block_6 = CodeBlock(a=code_block_5, b=count) { x=a-1; y=b-1; [x..y]; "fred"; }
getItemAtIndex_2 = List.GetItemAtIndex(list=replaceByCondition, index=code_block_6.out2)
countOccurrences = String.CountOccurrences(str=getItemAtIndex_2, searchFor=code_block_6.out3)
code_block_7 = CodeBlock { 1; }
eq_2 = countOccurrences == code_block_7
filterByBoolMask_3 = List.FilterByBoolMask(list=countOccurrences, mask=eq_2)
sum = Math.Sum(values=filterByBoolMask_3.in)
code_block_8 = CodeBlock { 2; }
ge_2 = sum >= code_block_8
filterByBoolMask_4 = List.FilterByBoolMask(list=getItemAtIndex_2, mask=ge_2)

# group: EXCEL DATA SORT BY SERIES AND NAME
watch = Watch(filterByBoolMask_4.in)
flatten_2 = List.Flatten(list=watch@L2)
code_block_9 = CodeBlock { 2; "fred"; }
chop = List.Chop(lengths=code_block_9.out0)  # unwired: list
map = List.Map(list=flatten_2, f_x=chop)
eq_3 = map == code_block_9.out1
filterByBoolMask_5 = List.FilterByBoolMask(list=map, mask=eq_3)
watch_2 = Watch(filterByBoolMask_5.out)
flatten_3 = List.Flatten(list=watch_2)
clean_2 = List.Clean(list=flatten_3)
chop_2 = List.Chop(list=clean_2, lengths=code_block_9.out0)

# group: STRING JOINING E.G. 1100-SETTING OUT
usually_4_7_settings = CodeBlock { 4; 7; }
remove = String.Remove(startIndex=usually_4_7_settings.out0, count=usually_4_7_settings.out1)  # unwired: str
transpose = List.Transpose(lists=chop_2)
code_block_10 = CodeBlock(A=transpose, B=transpose) { A[0]; B[1]; }
string_from_object = FromObject(obj=code_block_10.out0)
list_create = List.Create(item0=string_from_object, item1=code_block_10.out1)
code_block_11 = CodeBlock { "-"; }
transpose_2 = List.Transpose(lists=list_create)
join = String.Join(separator=code_block_11, string0=transpose_2)

# group: SORT SHEET NUMBER BY SERIES
code_block_12 = CodeBlock(A=list_create) { A[0]; }
code_block_13 = CodeBlock { 2; 2; }
remove_2 = String.Remove(str=code_block_12, startIndex=code_block_13.out0, count=code_block_13.out1)
remove_3 = String.Remove(str=filterByBoolMask_2.in, startIndex=code_block_13.out0, count=code_block_13.out1)
countOccurrences_2 = String.CountOccurrences(str=remove_2, searchFor=remove_3, lacing=CrossProduct)
sum_2 = Math.Sum(values=countOccurrences_2)
chop_3 = List.Chop(list=filterByBoolMask.in, lengths=sum_2)

# group: SET SHEET NUMBER SERIES
code_block_14 = CodeBlock { "Drawing Series"; }
flatten_4 = List.Flatten(list=join)
setParameterByName = Element.SetParameterByName(element=chop_3, parameterName=code_block_14, value=flatten_4)

code_block_15 = CodeBlock {  }
